# Grasshopper definition Boids_Game.gh (Grasshopper 1.0.8)

c_script = CSharpScript(reset=Button(), run=Toggle(True))  # -> out, points, colors, foods, box, info; inputs reset: Boolean, run: Boolean
# ---------- c_script: C# ----------
#load "C:\Users\GAI\Desktop\1103_my_plugin\boids_game\core\Arena.cs"
#load "C:\Users\GAI\Desktop\1103_my_plugin\boids_game\core\Contracts.cs"
#load "C:\Users\GAI\Desktop\1103_my_plugin\boids_game\core\Roster.cs"
// 檢查 boid_template.cs：範本，不載入
// Grasshopper Script Instance：Boids 競技場主程式（只有老師改這個檔；它由 tools\gen_host.py 產生 host_script.cs）
// 輸入
//   reset bool 重來（Button）　run bool 前進一步（接 Timer 的 Boolean Toggle）　（種子固定在 Arena.GlobalSeed，沒有 seed 輸入）
// 輸出
//   points DataTree<Point3d>（每隊一個分支）　colors List<Color>（每隊一個顏色，順序同分支）
//   foods List<Point3d>　box Box（目前場地）　info string（各隊存活數、擊殺數）
#region Usings
using System;
using System.Linq;
using System.Collections;
using System.Collections.Generic;
using System.Drawing;

using Rhino;
using Rhino.Geometry;
using Rhino.Geometry.Intersect;
using BoidArena;

using Grasshopper;
using Grasshopper.Kernel;
using Grasshopper.Kernel.Data;
using Grasshopper.Kernel.Types;
#endregion

public class Script_Instance : GH_ScriptInstance
{
    // 跨次運算保留
    private Arena arena = null;
    private List<string> rejected = new List<string>();
    private string engineError = "";

    private void RunScript(
		bool reset,
		bool run,
		ref object points,
		ref object colors,
		ref object foods,
		ref object box,
		ref object info)
    {
        try
        {
            if (reset || arena == null)
            {
                List<IBrain> brains = Roster.Find(typeof(Script_Instance).Assembly, out rejected);
                arena = new Arena(brains, Arena.GlobalSeed);
                engineError = "";
            }
            else if (run && engineError == "")
            {
                arena.RunStep();
            }
        }
        catch (Exception ex)
        {
            // 引擎自己出錯：停在目前這一步，不讓 GH 整個爆掉
            engineError = ex.GetType().Name + ": " + ex.Message;
        }
        if (arena == null)
        {
            info = "引擎建立失敗：" + engineError;
            return;
        }

        var tree = new DataTree<Point3d>();
        var colorList = new List<Color>();
        for (int team = 0; team < arena.Brains.Count; team++)
        {
            tree.EnsurePath(new GH_Path(team));
            colorList.Add(arena.TeamColors[team]);
        }
        foreach (Agent agent in arena.Agents)
            tree.Add(agent.Position, new GH_Path(agent.Team));

        double h = arena.HalfSize;
        points = tree;
        colors = colorList;
        foods = new List<Point3d>(arena.Foods);
        box = new Box(Plane.WorldXY, new Interval(-h, h), new Interval(-h, h), new Interval(-h, h));

        int[] alive = arena.AliveByTeam();
        var lines = new List<string>();
        lines.Add(string.Format("步 {0}　總數 {1}/{2}　食物 {3}　場地半邊 {4:F1}　種子 {5}",
            arena.Step, arena.AliveCount, Arena.Cap, arena.Foods.Count, h, Arena.GlobalSeed));
        if (engineError != "") lines.Add("引擎錯誤（已暫停）：" + engineError);
        for (int team = 0; team < arena.Brains.Count; team++)
            lines.Add(string.Format("{0}　存活 {1}　擊殺 {2}　{3}",
                arena.TeamNames[team], alive[team], arena.TeamKills[team], arena.Status[team]));
        foreach (string text in rejected) lines.Add("未參賽：" + text);
        info = string.Join("\n", lines);
    }
}
# ---------- end c_script ----------
brep_wireframe = BrepWireframe(Brep=c_script.box, Density=-1)
custom_preview = CustomPreview(Geometry=c_script.points, Material=c_script.colors)
